% Simulink data dictionary GalacticSoupFunctionalInterfaces.sldd

RecipeCommand = Simulink.Bus()
  recipeId: string
  batchSize: double

RawIngredients = Simulink.Bus()
  items: string

PreparedProduce = Simulink.Bus()
  items: string

PortionedIngredients = Simulink.Bus()
  items: string

CookedSoup = Simulink.Bus()
  batchId: string
  volume: double

InspectedSoup = Simulink.Bus()
  batchId: string
  qualityStatus: string

PackagedBatch = Simulink.Bus()
  batchId: string
  containerCount: double
  destination: string

Manifest = Simulink.Bus()
  batchId: string
  destination: string
  timestamp: string

InventoryState = Simulink.Bus()
  stockLevels: string

EnvironmentState = Simulink.Bus()
  ambientGravity: double
  ambientConditions: string

SystemStatus = Simulink.Bus()
  componentStates: string

HeatSetpoint = Simulink.Bus()
  targetTemp: double

StirCommand = Simulink.Bus()
  speed: double
  cadence: double

HeatCommand = Simulink.Bus()
  power: double

Temperature = Simulink.Bus()
  value: double