% Simulink data dictionary GalacticSoupPhysicalInterfaces.sldd

RecipeCommand = Simulink.Bus()
  recipeId: string
  batchSize: double
  priority: double

RawIngredients = Simulink.Bus()
  items: string
  quantities: double

PreparedProduce = Simulink.Bus()
  items: string
  cutSize: double

PortionedIngredients = Simulink.Bus()
  items: string
  masses: double

CookedSoup = Simulink.Bus()
  batchId: string
  volume: double
  temperature: double

InspectedSoup = Simulink.Bus()
  batchId: string
  qualityStatus: string
  contamLevel: double
  temperature: double

PackagedBatch = Simulink.Bus()
  batchId: string
  containerCount: double
  destination: string
  sealStatus: string

Manifest = Simulink.Bus()
  batchId: string
  destination: string
  timestamp: string
  carrier: string

InventoryState = Simulink.Bus()
  stockLevels: string
  reorderFlags: string

EnvironmentState = Simulink.Bus()
  ambientGravity: double
  temperature: double
  humidity: double

SystemStatus = Simulink.Bus()
  componentStates: string
  alarms: string
  operatorLoad: double

HeatSetpoint = Simulink.Bus()
  targetTemp: double

StirCommand = Simulink.Bus()
  speed: double
  cadence: double

HeatCommand = Simulink.Bus()
  power: double

Temperature = Simulink.Bus()
  value: double