# Requirement set SystemRequirements (R2025b)

## 1 [SR-GS-001] Recipe count
System shall cook at least 8 distinct recipes selectable at runtime. Pass: >= 8 recipes available.
Rationale: Derived from SN-GS-001.

## 2 [SR-GS-002] Throughput
System shall sustain total throughput >= 200 bowls/hour. Pass: measured throughput >= 200 bowls/h.
Rationale: Derived from SN-GS-001.

## 3 [SR-GS-003] Automation level
System shall achieve average automation level >= 0.8 across components. Pass: mean(automationLevel) >= 0.8.
Rationale: Derived from SN-GS-002.

## 4 [SR-GS-004] Operator count
System shall require <= 5 concurrent operators at peak load. Pass: peak operator count <= 5.
Rationale: Derived from SN-GS-002.

## 5 [SR-GS-005] Shipping manifest
System shall generate a shipping manifest per batch including destination. Pass: manifest present with populated address field.
Rationale: Derived from SN-GS-003.

## 6 [SR-GS-006] Transport loading time
System shall load packaged soup onto transport within 10 minutes of packaging. Pass: elapsed time <= 10 min.
Rationale: Derived from SN-GS-003.

## 7 [SR-GS-007] Contamination detection
System shall detect contamination before sealing with >= 99% sensitivity. Pass: sensitivity >= 0.99.
Rationale: Derived from SN-GS-004.

## 8 [SR-GS-008] Serving temperature
System shall verify soup temperature in 70-95 C before QC sign-off. Pass: 70 <= T <= 95 C.
Rationale: Derived from SN-GS-004.

## 9 [SR-GS-009] Container seal life
System shall seal containers rated for 30-day interstellar transit. Pass: shelf-life >= 30 d and leak-tight.
Rationale: Derived from SN-GS-005.

## 10 [SR-GS-010] Inventory accuracy
System shall track ingredient inventory with <= 1% stock error. Pass: |measured - recorded| / recorded <= 0.01.
Rationale: Derived from SN-GS-006.

## 11 [SR-GS-011] Mass budget
Total system mass shall not exceed 15000 kg. Pass: sum(mass) <= 15000 kg.
Rationale: Derived from SN-GS-007.

## 12 [SR-GS-012] Power budget
Total system power draw shall not exceed 500 kW. Pass: sum(power) <= 500 kW.
Rationale: Derived from SN-GS-007.

## 13 [SR-GS-013] Cost budget
Total system cost shall not exceed 2000000 credits. Pass: sum(cost) <= 2e6 credits.
Rationale: Derived from SN-GS-007.

## 14 [SR-GS-014] Volume budget
Total system volume shall not exceed 400 m^3. Pass: sum(volume) <= 400 m^3.
Rationale: Derived from SN-GS-007.

## 15 [SR-GS-015] Gravity operating range
System shall perform all cooking, packaging, and shipping functions nominally across ambient gravity 0.1 g - 12 g. Pass: full functional test passes at 0.1, 1, 6, 12 g.
Rationale: Derived from SN-GS-008.

## 16 [SR-GS-016] Structural 12 g tolerance
System structure and mounts shall withstand sustained 12 g loading without permanent deformation. Pass: no yield at 12 g load with factor of safety >= 1.5.
Rationale: Derived from SN-GS-008.