% Requirement links of SystemRequirements.slreqx (R2025b)

#1 derives StakeholderNeeds.slreqx#1
#1 refines GalacticSoupFunctional.slx#11: OrchestrateOperations
#1 refines GalacticSoupFunctional.slx#61: ExecuteRecipe
#1 refines GalacticSoupFunctional.slx#3: ProcessProduce
#1 refines GalacticSoupFunctional.slx#4: PortionIngredients
#10 derives StakeholderNeeds.slreqx#6
#10 refines GalacticSoupFunctional.slx#9: TrackInventory
#10 refines GalacticSoupFunctional.slx#4: PortionIngredients
#10 refines GalacticSoupLogical.slx#9: InventoryTracker
#10 refines GalacticSoupLogical.slx#4: PortioningUnit
#11 derives StakeholderNeeds.slreqx#7
#11 refines GalacticSoupFunctional.slx#11: OrchestrateOperations
#11 refines GalacticSoupPhysical.slx#1: CryoPantry
#11 refines GalacticSoupPhysical.slx#2: AugerDispenser
#11 refines GalacticSoupPhysical.slx#3: RoboPrepStation
#11 refines GalacticSoupPhysical.slx#4: PrecisionScale
#11 refines GalacticSoupPhysical.slx#5: CookingStation
#11 refines GalacticSoupPhysical.slx#6: QualitySensorSuite
#11 refines GalacticSoupPhysical.slx#7: SealingLine
#11 refines GalacticSoupPhysical.slx#8: LoaderArm
#11 refines GalacticSoupPhysical.slx#9: InventoryDB
#11 refines GalacticSoupPhysical.slx#10: GravityIMU
#11 refines GalacticSoupPhysical.slx#11: KitchenController
#12 derives StakeholderNeeds.slreqx#7
#12 refines GalacticSoupFunctional.slx#11: OrchestrateOperations
#12 refines GalacticSoupPhysical.slx#1: CryoPantry
#12 refines GalacticSoupPhysical.slx#2: AugerDispenser
#12 refines GalacticSoupPhysical.slx#3: RoboPrepStation
#12 refines GalacticSoupPhysical.slx#4: PrecisionScale
#12 refines GalacticSoupPhysical.slx#5: CookingStation
#12 refines GalacticSoupPhysical.slx#6: QualitySensorSuite
#12 refines GalacticSoupPhysical.slx#7: SealingLine
#12 refines GalacticSoupPhysical.slx#8: LoaderArm
#12 refines GalacticSoupPhysical.slx#9: InventoryDB
#12 refines GalacticSoupPhysical.slx#10: GravityIMU
#12 refines GalacticSoupPhysical.slx#11: KitchenController
#13 derives StakeholderNeeds.slreqx#7
#13 refines GalacticSoupFunctional.slx#11: OrchestrateOperations
#13 refines GalacticSoupPhysical.slx#1: CryoPantry
#13 refines GalacticSoupPhysical.slx#2: AugerDispenser
#13 refines GalacticSoupPhysical.slx#3: RoboPrepStation
#13 refines GalacticSoupPhysical.slx#4: PrecisionScale
#13 refines GalacticSoupPhysical.slx#5: CookingStation
#13 refines GalacticSoupPhysical.slx#6: QualitySensorSuite
#13 refines GalacticSoupPhysical.slx#7: SealingLine
#13 refines GalacticSoupPhysical.slx#8: LoaderArm
#13 refines GalacticSoupPhysical.slx#9: InventoryDB
#13 refines GalacticSoupPhysical.slx#10: GravityIMU
#13 refines GalacticSoupPhysical.slx#11: KitchenController
#14 derives StakeholderNeeds.slreqx#7
#14 refines GalacticSoupFunctional.slx#11: OrchestrateOperations
#14 refines GalacticSoupPhysical.slx#1: CryoPantry
#14 refines GalacticSoupPhysical.slx#2: AugerDispenser
#14 refines GalacticSoupPhysical.slx#3: RoboPrepStation
#14 refines GalacticSoupPhysical.slx#4: PrecisionScale
#14 refines GalacticSoupPhysical.slx#5: CookingStation
#14 refines GalacticSoupPhysical.slx#6: QualitySensorSuite
#14 refines GalacticSoupPhysical.slx#7: SealingLine
#14 refines GalacticSoupPhysical.slx#8: LoaderArm
#14 refines GalacticSoupPhysical.slx#9: InventoryDB
#14 refines GalacticSoupPhysical.slx#10: GravityIMU
#14 refines GalacticSoupPhysical.slx#11: KitchenController
#15 derives StakeholderNeeds.slreqx#8
#15 refines GalacticSoupFunctional.slx#10: MonitorEnvironment
#15 refines GalacticSoupFunctional.slx#3: ProcessProduce
#15 refines GalacticSoupFunctional.slx#4: PortionIngredients
#15 refines GalacticSoupFunctional.slx#60: StirContents
#15 refines GalacticSoupFunctional.slx#59: ControlHeating
#15 refines GalacticSoupFunctional.slx#7: PackageSoup
#15 refines GalacticSoupLogical.slx#10: EnvironmentSensor
#15 refines GalacticSoupLogical.slx#3: PrepProcessor
#15 refines GalacticSoupLogical.slx#4: PortioningUnit
#15 refines GalacticSoupLogical.slx#60: StirringMechanism
#15 refines GalacticSoupLogical.slx#59: HeatingController
#15 refines GalacticSoupLogical.slx#7: PackagingUnit
#15 refines GalacticSoupPhysical.slx#10: GravityIMU
#15 refines GalacticSoupPhysical.slx#4: PrecisionScale
#15 refines GalacticSoupPhysical.slx#3: RoboPrepStation
#15 refines GalacticSoupPhysical.slx#5: CookingStation
#15 refines GalacticSoupPhysical.slx#7: SealingLine
#16 derives StakeholderNeeds.slreqx#8
#16 refines GalacticSoupFunctional.slx#11: OrchestrateOperations
#16 refines GalacticSoupFunctional.slx#10: MonitorEnvironment
#16 refines GalacticSoupPhysical.slx#1: CryoPantry
#16 refines GalacticSoupPhysical.slx#2: AugerDispenser
#16 refines GalacticSoupPhysical.slx#3: RoboPrepStation
#16 refines GalacticSoupPhysical.slx#4: PrecisionScale
#16 refines GalacticSoupPhysical.slx#5: CookingStation
#16 refines GalacticSoupPhysical.slx#6: QualitySensorSuite
#16 refines GalacticSoupPhysical.slx#7: SealingLine
#16 refines GalacticSoupPhysical.slx#8: LoaderArm
#16 refines GalacticSoupPhysical.slx#9: InventoryDB
#16 refines GalacticSoupPhysical.slx#10: GravityIMU
#16 refines GalacticSoupPhysical.slx#11: KitchenController
#2 derives StakeholderNeeds.slreqx#1
#2 refines GalacticSoupFunctional.slx#3: ProcessProduce
#2 refines GalacticSoupFunctional.slx#4: PortionIngredients
#2 refines GalacticSoupFunctional.slx#61: ExecuteRecipe
#2 refines GalacticSoupFunctional.slx#7: PackageSoup
#2 refines GalacticSoupFunctional.slx#8: ShipSoup
#2 refines GalacticSoupFunctional.slx#11: OrchestrateOperations
#2 refines GalacticSoupLogical.slx#11: ControlUnit
#2 refines GalacticSoupLogical.slx#3: PrepProcessor
#2 refines GalacticSoupLogical.slx#4: PortioningUnit
#2 refines GalacticSoupLogical.slx#61: RecipeExecutor
#2 refines GalacticSoupLogical.slx#7: PackagingUnit
#2 refines GalacticSoupLogical.slx#8: ShippingUnit
#3 derives StakeholderNeeds.slreqx#2
#3 refines GalacticSoupFunctional.slx#11: OrchestrateOperations
#3 refines GalacticSoupLogical.slx#11: ControlUnit
#4 derives StakeholderNeeds.slreqx#2
#4 refines GalacticSoupFunctional.slx#11: OrchestrateOperations
#4 refines GalacticSoupLogical.slx#11: ControlUnit
#5 derives StakeholderNeeds.slreqx#3
#5 refines GalacticSoupFunctional.slx#8: ShipSoup
#6 derives StakeholderNeeds.slreqx#3
#6 refines GalacticSoupFunctional.slx#8: ShipSoup
#6 refines GalacticSoupFunctional.slx#11: OrchestrateOperations
#6 refines GalacticSoupLogical.slx#8: ShippingUnit
#6 refines GalacticSoupLogical.slx#11: ControlUnit
#6 refines GalacticSoupPhysical.slx#8: LoaderArm
#7 derives StakeholderNeeds.slreqx#4
#7 refines GalacticSoupFunctional.slx#6: InspectQuality
#7 refines GalacticSoupLogical.slx#6: QualitySensingUnit
#7 refines GalacticSoupPhysical.slx#6: QualitySensorSuite
#8 derives StakeholderNeeds.slreqx#4
#8 refines GalacticSoupFunctional.slx#6: InspectQuality
#8 refines GalacticSoupFunctional.slx#59: ControlHeating
#8 refines GalacticSoupLogical.slx#6: QualitySensingUnit
#8 refines GalacticSoupLogical.slx#59: HeatingController
#8 refines GalacticSoupPhysical.slx#6: QualitySensorSuite
#8 refines GalacticSoupPhysical.slx#5: CookingStation
#9 derives StakeholderNeeds.slreqx#5
#9 refines GalacticSoupFunctional.slx#7: PackageSoup
#9 refines GalacticSoupPhysical.slx#7: SealingLine