% Simulink data dictionary FCSFunctionalInterfaces.sldd

PowerSignal = Simulink.Bus()
  Power: double

CrewInput = Simulink.Bus()
  RollRateCmd: double
  PitchRateCmd: double
  YawRateCmd: double

AircraftStateData = Simulink.Bus()
  RollRate: double
  PitchRate: double
  YawRate: double
  Airspeed: double
  AltitudeFt: double
  AngleOfAttack: double

ControlCommand = Simulink.Bus()
  Elevator: double
  LeftAileron: double
  RightAileron: double
  Rudder: double

ControlFeedback = Simulink.Bus()
  Elevator: double
  LeftAileron: double
  RightAileron: double
  Rudder: double

SystemStatus = Simulink.Bus()
  StatusWord: double