% Simulink data dictionary FCSPhysicalInterfaces.sldd

ElectricalPower = Simulink.Bus()
  Voltage: double
  Current: double

PilotCommand = Simulink.Bus()
  RollRateCmd: double
  PitchRateCmd: double
  YawRateCmd: double

SensorData = Simulink.Bus()
  RollRate: double
  PitchRate: double
  YawRate: double
  Airspeed: double
  AltitudeFt: double
  AngleOfAttack: double

ControlSurfaceCmd = Simulink.Bus()
  Elevator: double
  LeftAileron: double
  RightAileron: double
  Rudder: double

ControlSurfaceFbk = Simulink.Bus()
  Elevator: double
  LeftAileron: double
  RightAileron: double
  Rudder: double

DataBusMsg = Simulink.Bus()
  Data: double