# Requirement set SystemRequirements (R2025b)

## 1 [SR-FCS-001] Roll rate command range
The FCS shall accept roll rate commands in the range -180 to +180 deg/s from the pilot inceptors.
Rationale: Covers the full aerobatic roll envelope.

## 2 [SR-FCS-002] Pitch rate command range
The FCS shall accept pitch rate commands in the range -30 to +30 deg/s from the pilot inceptors.
Rationale: Covers normal and emergency pitch maneuvers.

## 3 [SR-FCS-003] Yaw rate command range
The FCS shall accept yaw rate commands in the range -30 to +30 deg/s from the pilot inceptors.
Rationale: Covers coordinated turns and crosswind operations.

## 4 [SR-FCS-004] Pitch attitude hold accuracy
The FCS shall maintain pitch attitude within 0.5 deg of the commanded value in steady-state at all airspeeds within the normal flight envelope.
Rationale: Minimum accuracy for instrument flight procedures.

## 5 [SR-FCS-005] Roll attitude hold accuracy
The FCS shall maintain roll attitude within 1.0 deg of the commanded value in steady-state at all airspeeds within the normal flight envelope.
Rationale: Minimum accuracy for instrument flight procedures.

## 6 [SR-FCS-006] Control loop stability margins
The FCS shall provide a minimum phase margin of 45 deg and gain margin of 6 dB at all control loop crossover frequencies.
Rationale: Standard robustness margins for flight control; complies with MIL-HDBK-1797.

## 7 [SR-FCS-007] Control loop execution rate
The FCS control laws shall execute at a minimum rate of 100 Hz.
Rationale: Required to achieve Level 1 bandwidth per MIL-STD-1797.

## 8 [SR-FCS-008] End-to-end command latency
The FCS shall respond to pilot inceptor inputs with an end-to-end latency not exceeding 100 ms, measured from inceptor deflection to control surface position change.
Rationale: Required for Level 1 handling qualities; excessive latency degrades pilot-vehicle coupling.

## 9 [SR-FCS-009] Redundant computation
The FCS shall implement dual-redundant flight computers with automatic failover upon detection of a failure in the active channel.
Rationale: Ensures continued flight control following a single computer failure.

## 10 [SR-FCS-010] Failure detection latency
The FCS shall detect and isolate a single hardware failure within 50 ms of occurrence.
Rationale: Limits crew exposure time after a failure; aligns with DO-178C objectives.

## 11 [SR-FCS-011] Power supply redundancy
The FCS shall operate from a minimum of two electrically independent power supply paths, with automatic switchover upon loss of the primary path.
Rationale: Power loss must not result in loss of flight control capability.

## 12 [SR-FCS-012] Built-in test coverage
The FCS built-in test equipment (BITE) shall achieve a fault detection coverage of no less than 95% of all detectable faults during power-on and continuous monitoring.
Rationale: Reduces reliance on external test equipment and shortens fault isolation time.

## 13 [SR-FCS-013] Maintenance data bus
The FCS shall provide a maintenance data bus interface compliant with ARINC 604 for interrogation by standard ground support equipment.
Rationale: Enables use of common GSE across the fleet; reduces training burden.

## 14 [SR-FCS-014] Total power budget
The total electrical power consumed by all FCS equipment shall not exceed 450 W.
Rationale: Platform power bus allocation for avionics; margin held by aircraft integrator.

## 15 [SR-FCS-015] Total mass budget
The total mass of all FCS equipment shall not exceed 35 kg.
Rationale: Structural mass allocation from the aircraft weight and balance budget.