% Requirement links of SystemRequirements.slreqx (R2025b)

#1 derives StakeholderNeeds.slreqx#1
#1 refines FCSSystem.slx#2: PilotInterface
#1 refines FCSSystem.slx#1: FlightComputer
#10 derives StakeholderNeeds.slreqx#4
#10 refines FCSSystem.slx#1: FlightComputer
#10 refines FCSSystem.slx#6: DataBus
#11 derives StakeholderNeeds.slreqx#4
#11 refines FCSSystem.slx#5: PowerSystem
#12 derives StakeholderNeeds.slreqx#5
#12 refines FCSSystem.slx#1: FlightComputer
#12 refines FCSSystem.slx#6: DataBus
#13 derives StakeholderNeeds.slreqx#5
#13 refines FCSSystem.slx#6: DataBus
#14 derives StakeholderNeeds.slreqx#6
#15 derives StakeholderNeeds.slreqx#6
#2 derives StakeholderNeeds.slreqx#1
#2 refines FCSSystem.slx#2: PilotInterface
#2 refines FCSSystem.slx#1: FlightComputer
#3 derives StakeholderNeeds.slreqx#1
#3 refines FCSSystem.slx#2: PilotInterface
#3 refines FCSSystem.slx#1: FlightComputer
#4 derives StakeholderNeeds.slreqx#2
#4 refines FCSSystem.slx#1: FlightComputer
#4 refines FCSSystem.slx#3: SensorSuite
#4 refines FCSSystem.slx#4: ActuatorSystem
#5 derives StakeholderNeeds.slreqx#2
#5 refines FCSSystem.slx#1: FlightComputer
#5 refines FCSSystem.slx#3: SensorSuite
#5 refines FCSSystem.slx#4: ActuatorSystem
#6 derives StakeholderNeeds.slreqx#2
#6 refines FCSSystem.slx#1: FlightComputer
#7 derives StakeholderNeeds.slreqx#3
#7 refines FCSSystem.slx#1: FlightComputer
#8 derives StakeholderNeeds.slreqx#3
#8 refines FCSSystem.slx#1: FlightComputer
#8 refines FCSSystem.slx#3: SensorSuite
#8 refines FCSSystem.slx#4: ActuatorSystem
#8 refines FCSSystem.slx#6: DataBus
#9 derives StakeholderNeeds.slreqx#4
#9 refines FCSSystem.slx#1: FlightComputer