test file "FCSTests"
  description: FCS system-level verification tests. One test case per TC requirement.

suite "Command Interface"
  tags: command

  case "TC-FCS-001" [simulation]
    description: Apply roll rate commands at -180, 0, and +180 deg/s via the pilot inceptor interface. Verify that the FCS accepts and processes all commands without saturation or rejection.
    tags: command

  case "TC-FCS-002" [simulation]
    description: Apply pitch rate commands at -30, 0, and +30 deg/s via the pilot inceptor interface. Verify that the FCS accepts and processes all commands without saturation or rejection.
    tags: command

  case "TC-FCS-003" [simulation]
    description: Apply yaw rate commands at -30, 0, and +30 deg/s via the pilot inceptor interface. Verify that the FCS accepts and processes all commands without saturation or rejection.
    tags: command

suite "Stability"
  tags: stability

  case "TC-FCS-004" [simulation]
    description: Command a series of pitch attitudes across the flight envelope. After transient settling, record steady-state pitch error. Pass criterion: error <= 0.5 deg at all test points.
    tags: stability

  case "TC-FCS-005" [simulation]
    description: Command a series of roll attitudes across the flight envelope. After transient settling, record steady-state roll error. Pass criterion: error <= 1.0 deg at all test points.
    tags: stability

  case "TC-FCS-006" [simulation]
    description: Inject frequency sweeps at each control loop breakout point. Compute open-loop frequency response. Pass criterion: phase margin >= 45 deg and gain margin >= 6 dB at all crossover frequencies.
    tags: stability

suite "Handling Qualities"
  tags: handling

  case "TC-FCS-007" [simulation]
    description: Instrument the flight computer control law task. Record execution timestamps over 10 seconds of operation. Pass criterion: measured rate >= 100 Hz with jitter <= 1 ms.
    tags: handling

  case "TC-FCS-008" [simulation]
    description: Apply a step input at the pilot inceptor and record control surface position response using high-speed data acquisition. Pass criterion: time from inceptor deflection to first surface movement <= 100 ms.
    tags: handling

suite "Failure Safety"
  tags: safety

  case "TC-FCS-009" [simulation]
    description: With the system operational, inject a simulated primary flight computer failure. Verify that the standby channel assumes control. Pass criterion: flight control maintained with no pilot intervention; failover logged.
    tags: safety

  case "TC-FCS-010" [simulation]
    description: Inject a single hardware fault at a known test point. Measure time from fault injection to BITE fault flag assertion. Pass criterion: detection and isolation <= 50 ms.
    tags: safety

  case "TC-FCS-011" [simulation]
    description: With the system operational, remove primary power. Verify that secondary power path activates and flight control is maintained. Pass criterion: no loss of control; switchover time <= 20 ms.
    tags: safety

suite "Maintainability"
  tags: maintain

  case "TC-FCS-012" [simulation]
    description: Execute the BITE test sequence against the fault catalogue. Record detected vs total detectable faults. Pass criterion: detection coverage >= 95%.
    tags: maintain

  case "TC-FCS-013" [simulation]
    description: Connect standard ARINC 604-compliant GSE to the maintenance bus port. Execute the standard interrogation sequence. Pass criterion: all mandatory ARINC 604 labels transmitted and received within timing tolerances.
    tags: maintain